# Grasshopper definition assignment-01.gh (Grasshopper 1.0.8)

# ---- group: design choices / parameters for grid
# Assignment-01: Bauhaus
grid_count = Slider(20, range=1..50)
size_of_grid = Slider(1, range=0..10)
seed = Slider(20, range=1..100)
radius_grid_pipes = Slider(0.05, range=0.001..1)
construct_plane = ConstructPlane(Origin=Point(0, 0, 0), XAxis=Vector(1, 0, 0), YAxis=Vector(0, 1, 0))

# ---- group: design choices / parameters for forms
cylinder_count = Slider(2, range=1..8)
cones_count = Slider(2, range=1..8)
spheres_count = Slider(2, range=1..8)
quarter_cylinders_count = Slider(5, range=1..8)
height_cone = Slider(2.504, range=0.001..10)
height_cylinder = Slider(0.807, range=0.001..10)
height_quarter_cylinder = Slider(1.084, range=0.001..10)

# ----
height_cuboid = Slider(0.434, range=0.001..10)
cuboid_count = Slider(8, range=1..8)

# ---- group: Construct Grid with Random Parameter
polyomino = Python3Script(N=grid_count, Plane=construct_plane, Size=size_of_grid, Seed=seed)  # -> surfaces, centers, cells; inputs N: Int32, Plane: Plane, Size: Double
# ---------- polyomino: Python ----------
# import function
#from cdf.geometry_basics import create_random_polyomino

# call function
#my_polyomino = create_random_polyomino(n=N, plane=Plane, size=Size, seed=Seed)

from cdf.geometry_basics import create_random_polyomino

squares, surfaces, centers, cells = create_random_polyomino(
    n=N,
    plane=Plane,
    size=Size,
    seed=Seed
)
# ---------- end polyomino ----------
surface = Surface(polyomino.surfaces)
point = Point(polyomino.centers)
face_boundaries = FaceBoundaries(Mesh=surface)
curve = Curve(face_boundaries)
pipe = Pipe(Curve=curve, Radius=radius_grid_pipes, Caps=2, FitRail=False)

# ---- group: Assign shapes to grids with a random parameter
split_list = Python3Script(
    Points=point,
    CountSphere=spheres_count,
    CountCylinder=cylinder_count,
    CountCone=cones_count,
    CountQuarterCylinder=quarter_cylinders_count,
    CountCuboid=cuboid_count)  # -> cone_points, sphere_points, quarter_cylinder_points, cylinder_points, cuboid_points; inputs Points: tree of Point3d, CountSphere: Int32, CountCylinder: Int32, CountCone: Int32, CountQuarterCylinder: Int32
# ---------- split_list: Python ----------
import sys
import importlib

src_path = r"C:\Users\valen\workspace\cdf1_teaching\src"

if src_path not in sys.path:
    sys.path.insert(0, src_path)

import cdf.geometry_basics as geometry_basics
importlib.reload(geometry_basics)

result = geometry_basics.split_random_points(
    points=Points,
    count_sphere=int(CountSphere),
    count_cylinder=int(CountCylinder),
    count_cone=int(CountCone),
    count_quarter_cylinder=int(CountQuarterCylinder),
    count_cuboid=int(CountCuboid)
)

cone_points = result[0]
sphere_points = result[1]
quarter_cylinder_points = result[2]
cylinder_points = result[3]
cuboid_points = result[4]

print("Cone:", len(cone_points))
print("Sphere:", len(sphere_points))
print("QuarterCylinder:", len(quarter_cylinder_points))
print("Cylinder:", len(cylinder_points))
print("Cuboid:", len(cuboid_points))
# ---------- end split_list ----------
quarter_cylinder_center_points = Point(graft(split_list.quarter_cylinder_points))
cylinder_center_points = Point(graft(split_list.cylinder_points))
sphere_center_points = Point(graft(split_list.sphere_points))
cone_center_points = Point(graft(split_list.cone_points))
cuboid_center_points = Point(graft(split_list.cuboid_points))

# ---- group: construct sphere
subtraction = Subtraction(A=size_of_grid, B=radius_grid_pipes)
multiplication = Multiplication(A=subtraction, B="0.5")
sphere = Python3Script(pt=sphere_center_points, r=multiplication)  # -> out, my_sphere; inputs pt: Point3d, r: Double
# ---------- sphere: Python ----------
# import function
from cdf import create_sphere

# call function
my_sphere = create_sphere(center_point=pt, radius=r)
# ---------- end sphere ----------

# ---- group: construct cone
unit_z = UnitZ(Factor=expr("x*-1", height_cone))
cone = Python3Script(pt=cone_center_points, h=height_cone, r=multiplication)  # -> out, my_cone; inputs pt: Point3d
# ---------- cone: Python ----------
# import function
from cdf import create_cone

# call function
my_cone = create_cone(base_point=pt, height=h, radius=r)
# ---------- end cone ----------
move = Move(Geometry=cone.my_cone, Motion=unit_z)  # -> Geometry, Transform
mirror = Mirror(Geometry=move.Geometry, Plane=construct_plane)  # -> Geometry, Transform
solid_union = SolidUnion(Breps=[move.Geometry, mirror.Geometry])

# ---- group: construct cylinder
unit_z_2 = UnitZ(Factor=expr("x*-1", height_cylinder))
cylinder = Python3Script(pt=cylinder_center_points, h=height_cylinder, r=multiplication)  # -> my_cylinder; inputs pt: Point3d, h: Double, r: Double
# ---------- cylinder: Python ----------
# import function
from cdf import create_cylinder

# call function
my_cylinder = create_cylinder(base_point=pt, radius=r, height=h)
# ---------- end cylinder ----------
move_2 = Move(Geometry=cylinder, Motion=expr("x/2", unit_z_2))  # -> Geometry, Transform

# ---- group: construct quarter cylinder
quarter_cylinder = Python3Script(pt=graft(quarter_cylinder_center_points), h=height_quarter_cylinder, r=subtraction)  # -> my_cylinder; inputs pt: Point3d, h: Double, r: Double
# ---------- quarter_cylinder: Python ----------
import sys
import importlib

src_path = r"C:\Users\valen\workspace\cdf1_teaching\src"

if src_path not in sys.path:
    sys.path.insert(0, src_path)

import cdf.geometry_basics as geometry_basics
importlib.reload(geometry_basics)

my_cylinder = geometry_basics.create_random_quarter_cylinder(
    center=pt,
    radius=float(r),
    height=float(h)
)
# ---------- end quarter_cylinder ----------
mirror_2 = Mirror(Geometry=quarter_cylinder, Plane=construct_plane)  # -> Geometry, Transform
solid_union_2 = SolidUnion(Breps=[quarter_cylinder, mirror_2.Geometry])

# ---- group: Construct cuboids
center_box = CenterBox(Base=cuboid_center_points, X=multiplication, Y=multiplication, Z=height_cuboid)

# ---- group: visualize
preview = CustomPreview(Geometry=pipe, Material=ColourSwatch(SwatchColor=RGB(0, 0, 0)))
preview_2 = CustomPreview(Geometry=sphere.my_sphere, Material=ColourSwatch(SwatchColor=RGB(153, 42, 20)))
preview_3 = CustomPreview(Geometry=solid_union, Material=ColourSwatch(SwatchColor=RGB(125, 125, 125)))
preview_4 = CustomPreview(Geometry=move_2.Geometry, Material=ColourSwatch(SwatchColor=RGB(196, 173, 0)))
preview_5 = CustomPreview(Geometry=center_box, Material=ColourSwatch(SwatchColor=RGB(135, 42, 92)))
preview_6 = CustomPreview(Geometry=solid_union_2, Material=ColourSwatch(SwatchColor=RGB(35, 41, 203)))
