# Grasshopper definition geometry_basics.ghx (Grasshopper 1.0.8)
# plug-ins: LunchBox

number_slider = Slider(10, range=0..100)
unit_x = UnitX(Factor=1)
pt = Point(Point(-0.4439523925, 0.05137995213, 0))
line = Line()
line_sdl = LineSDL(Start=pt, Direction=unit_x, Length=number_slider)
divide_curve = DivideCurve(Curve=line_sdl, Count=10, Kinks=False)  # -> Points, Tangents, Parameters
unit_z = UnitZ(Factor=1)
line_sdl_2 = LineSDL(Start=divide_curve.Points, Direction=unit_z, Length=number_slider)
move = Move(Geometry=divide_curve.Points, Motion=Vector(0, 0, 10))  # -> Geometry, Transform
divide_curve_2 = DivideCurve(Curve=line_sdl_2, Count=10, Kinks=False)  # -> flatten(Points), Tangents, Parameters
list_item = ListItem(List=divide_curve_2.Points, Index=Slider(31, range=0..100), Wrap=True)
panel = Panel(divide_curve_2.Points)
invert_matrix = InvertMatrix(Matrix=list_item, Tolerance=0)  # -> Matrix, Success
seed = Slider(0.6, range=0..1)
anzahl_kreise = Slider(3, range=0..10)
maximaler_durchmesser_kreise = Slider(4, range=0..10)
number_slider_2 = Slider(6, range=0..10)
point = Point(Point(0.7318466731, 0, 1.904359483))

# ---- group: Example: Build a Parametric Cone
pt_2 = Point(Point(-0.4439523925, 0.05137995213, 0))
number_slider_3 = Slider(2, range=1..10)
number_slider_4 = Slider(2, range=1..10)
cone = Python3Script(pt=pt_2, h=number_slider_3, r=number_slider_4)  # -> out, my_cone; inputs pt: Point3d
# ---------- cone: Python ----------
# import function
from cdf import create_cone

# call function
my_cone = create_cone(base_point=pt, height=h, radius=r)
# ---------- end cone ----------

# ---- group: Auto-reloads cdf module on VScode changes
# Setting path for Src AutoReloader: 1. Right click on Path
# 2. Choose "Select a directory"
# 3. Locate the ..\cdf1_teaching\src folder in your computer
# NOTES:
# 
# - Use Python 3 Script blocks for your functions.
# - Import your functions and classes as: from cdf import my_function, My_class
# - Don't forget to add and name your INPUT and OUTPUT parameters that match your functions correctly. If you zoom in to the Python component you will see the + sign to add and - to remove them.
# - You need to attach the accurate components to your INPUT parameters: sliders for integers or floats, toggles or buttons for booleans, text for strings, Rhino geometries etc. etc.
# - If an INPUT is  a list, you need to right-click the parameter to set it as LIST access. Sometimes you need to also set the type of the INPUT by clicking TYPE HINT and selecting the correct input type.
# - If you want to hide an object, right-click component and uncheck Preview. To visualize again, check Preview.
# - If you get errors, READ THEM! They often tell what's wrong in a simple language. If not, copy-paste to CoPilot and don't be afraid to play around!
# 
# For more Grasshopper Help, go to:
# https://developer.rhino3d.com/guides/scripting/scripting-component/#script-inputs-and-outputs
path = FilePath("C:\Users\valen\workspace\cdf1_teaching\src\")
autoreloader = Python3Script(src_path=path)  # -> out; inputs src_path: String
# ---------- autoreloader: Python ----------
#! python3
import sys, os, time
import scriptcontext as sc
import Rhino, System
from System.IO import FileSystemWatcher, NotifyFilters

VERSION = 1  
pkg = "cdf"

if not src_path:
    raise Exception("Connect a folder to src_path.")
path = os.path.normpath(src_path)
watch_dir = os.path.join(path, pkg)
if not os.path.isdir(watch_dir):
    raise Exception("No '{}' folder found in:\n{}".format(pkg, path))

def unload():
    for name in list(sys.modules):
        if name == pkg or name.startswith(pkg + "."):
            del sys.modules[name]

# Put this folder first in Python's search list
if path in sys.path:
    sys.path.remove(path)
sys.path.insert(0, path)

key = "cdf_watcher_" + str(ghenv.Component.InstanceGuid)
time_key = key + "_time"
version_key = key + "_version"

def stamp():
    sc.sticky[time_key] = time.strftime("%Y-%m-%d %H:%M:%S")

# Replace the old watcher if the folder changed or the script was updated
old = sc.sticky.get(key)
if old is not None and (os.path.normpath(old.Path) != watch_dir
                        or sc.sticky.get(version_key) != VERSION):
    old.Dispose()
    del sc.sticky[key]
    unload()

if key not in sc.sticky:
    comp = ghenv.Component
    last = [0.0]

    def reload_and_rerun():
        unload()
        stamp()
        doc = comp.OnPingDocument()
        if doc is None:            # reloader was deleted or the file closed
            return
        for obj in doc.Objects:
            if "Python" in obj.GetType().Name:
                obj.ExpireSolution(False)   # mark as out of date
        doc.NewSolution(False)              # recompute once

    def on_change(sender, e):
        if not e.FullPath.endswith(".py") or "__pycache__" in e.FullPath:
            return
        if time.time() - last[0] < 0.5:     # ignore the second event of a double save
            return
        last[0] = time.time()
        Rhino.RhinoApp.InvokeOnUiThread(System.Action(reload_and_rerun))

    w = FileSystemWatcher(watch_dir, "*.py")
    w.IncludeSubdirectories = True
    w.NotifyFilter = NotifyFilters.LastWrite
    w.Changed += on_change
    w.EnableRaisingEvents = True
    sc.sticky[key] = w
    sc.sticky[version_key] = VERSION
    stamp()                                  # time the watcher started

msg = "Last reloaded: {}\nWatching: {}".format(sc.sticky.get(time_key, "unknown"), watch_dir)
print(msg)
out = msg
# ---------- end autoreloader ----------
panel_2 = Panel(autoreloader)

# ---- group: TODO: Build a Parametric Sphere
sphere = Python3Script(pt=point, r=Slider(1, range=1..10))  # -> out, my_sphere; inputs pt: Point3d
# ---------- sphere: Python ----------
# import function
from cdf import create_sphere

# call function
my_sphere = create_sphere(center_point=pt, radius=r)
# ---------- end sphere ----------

# ---- group: TODO: Make Transformations
transformation = Python3Script(my_sphere=sphere.my_sphere, distance=Slider(3, range=1..10), count=Slider(1, range=1..10))  # -> out, my_spheres; inputs my_sphere: Brep
# ---------- transformation: Python ----------
from cdf import copy_brep_along_z

my_spheres = copy_brep_along_z(my_sphere, distance, count)
# ---------- end transformation ----------

# ---- group: TODO: Make a Boolean Difference
boolean = Python3Script(my_cone=cone.my_cone, my_sphere=sphere.my_sphere)  # -> out, result_geometry; inputs my_cone: Brep, my_sphere: Brep
# ---------- boolean: Python ----------
# import function
from cdf import boolean_difference

# call function
result_geometry = boolean_difference(brep_a = my_cone, brep_b = my_sphere)
# ---------- end boolean ----------

# ----
plane_surface = PlaneSurface(Plane=PlaneXY(0, 0, 0), XSize=Domain(-10, 10), YSize=Domain(-10, 10))

# ---- group: Visualize
swatch = ColourSwatch(SwatchColor=RGB(60, 230, 88))
preview = CustomPreview(Geometry=cone.my_cone, Material=swatch)  # disabled

swatch_2 = ColourSwatch(SwatchColor=RGB(255, 86, 88))
preview_2 = CustomPreview(Geometry=sphere.my_sphere, Material=swatch_2)

swatch_3 = ColourSwatch(SwatchColor=RGB(255, 86, 255))
preview_3 = CustomPreview(Geometry=boolean.result_geometry, Material=swatch_3)

swatch_4 = ColourSwatch(SwatchColor=RGB(255, 255, 96))
preview_4 = CustomPreview(Geometry=transformation.my_spheres, Material=swatch_4)

# ----
grid_structure = GridStructure(Surface=plane_surface, UDivisions=number_slider_2, VDivisions=number_slider_2)  # -> StructureLines, StructureNodes
list_length = ListLength(List=grid_structure.StructureNodes)
list_item_2 = ListItem(List=grid_structure.StructureNodes, Index=Slider(14, range=0..100), Wrap=True)
panel_3 = Panel([swatch_3, swatch_4, swatch_2, swatch])
random = Random(Range=list_length, Number=anzahl_kreise, Seed=seed, Integers=True)
random_2 = Random(Range=Domain(0, 1), Number=1, Seed=2)
random_3 = Random(Range=maximaler_durchmesser_kreise, Number=anzahl_kreise, Seed=seed, Integers=True)  # -> graft(Random)
list_item_3 = ListItem(List=grid_structure.StructureNodes, Index=random, Wrap=True)  # -> graft(Item)
cull_pattern = CullPattern(List=grid_structure.StructureNodes, CullPattern=list_item_3)
list_length_2 = ListLength(List=cull_pattern)  # -> flatten(Length)
list_item_4 = ListItem(List=list_length_2, Index=0, Wrap=True)
panel_4 = Panel(list_item_4)
random_4 = Random(Range=list_item_4, Number=anzahl_kreise, Seed=2, Integers=True)
list_item_5 = ListItem(List=panel_3, Index=0, Wrap=True)
panel_5 = Panel(random_3)
pipe = Pipe(Curve=grid_structure.StructureLines, Radius=Slider(0.05, range=0..1), Caps=2, FitRail=False)
list_item_6 = ListItem(List=cull_pattern, Index=random_4, Wrap=True)
panel_6 = Panel(cull_pattern)
panel_7 = Panel(list_item_3)
cone_2 = Python3Script(pt=list_item_6, h=number_slider_3, r=number_slider_4)  # -> out, my_cone; inputs pt: Point3d; same code as cone
sphere_2 = Python3Script(pt=list_item_3, r=random_3)  # -> out, my_sphere; inputs pt: Point3d; same code as sphere

# ---- group: Visualize
preview_5 = CustomPreview(Geometry=pipe, Material=ColourSwatch(SwatchColor=RGB(0, 0, 0)))

# ----
panel_8 = Panel(sphere_2.my_sphere)
swatch_5 = ColourSwatch(SwatchColor=RGB(255, 86, 88))
list_length_3 = ListLength(List=sphere_2.my_sphere)
preview_6 = CustomPreview(Geometry=cone_2.my_cone, Material=swatch_5)
preview_7 = CustomPreview(Geometry=sphere_2.my_sphere, Material=swatch_5)
seed_2 = Slider(1, range=0..1)
list_item_7 = ListItem(List=list_length_3, Index=0, Wrap=True)
random_5 = Random(Range=Domain(0, 1), Number=list_item_7, Seed=seed_2, Integers=True)
panel_9 = Panel([ColourSwatch(SwatchColor=RGB(255, 86, 255)), ColourSwatch(SwatchColor=RGB(255, 255, 96)), ColourSwatch(SwatchColor=RGB(255, 86, 88)), ColourSwatch(SwatchColor=RGB(60, 230, 88))])
panel_10 = Panel(random_5)
list_item_8 = ListItem(List=panel_9, Index=random_5, Wrap=True)
preview_8 = CustomPreview(Geometry=sphere_2.my_sphere, Material=list_item_8)
